# Grasshopper definition cnc4d_baba_profile.gh (Grasshopper 1.0.7)

leading_edge_distance = Slider(5, range=0..1000)
trailing_edge_distance = Slider(30, range=0..1000)
bottom_distance = Slider(10, range=0..50)

wing_span = Slider(600, range=0..1000)
wing_dihedral = Slider(0, range=0..90)
sweep_mm = Slider(45, range=0..100)

X = Slider(670, range=0..1000)
Y = Slider(320, range=0..1000)
max_height = Slider(120, range=0..1000)
travel_height = Slider(80, range=0..1000)
move_feedrate = Slider(600, range=50..800)
cut_feedrate = Slider(100, range=50..300)

resolution = Slider(500, range=0..1000)

leading_edge_distance_2 = Slider(5, range=0..1000)
trailing_edge_distance_2 = Slider(30, range=0..1000)
bottom_distance_2 = Slider(10, range=0..50)

mid_plane = Slider(30, range=0..50)

X_2 = Slider(675, range=0..1000)
Y_2 = Slider(320, range=0..1000)
max_height_2 = Slider(120, range=0..1000)
travel_height_2 = Slider(80, range=0..1000)
move_feedrate_2 = Slider(600, range=50..800)
cut_feedrate_2 = Slider(100, range=50..300)

resolution_2 = Slider(500, range=0..1000)

wing_span_2 = Slider(450, range=0..1000)
wing_dihedral_2 = Slider(1, range=0..90)
sweep_mm_2 = Slider(45, range=0..100)

spar_width = Slider(5, range=0..20)
mid_plane_2 = Slider(30, range=0..50)
both_wings = BooleanToggle(False)
fast_feedrate = Slider(600, range=50..850)
cut_feedrate_3 = Slider(100, range=50..300)
root_kerf = Slider(1, range=0..10)
both_wings_2 = BooleanToggle(True)
resolution_3 = Slider(365, range=1..10000)
crv = Curve(<curve referenced from the Rhino model>)
tip_washout = Slider(2, range=0..20)
tip_washout_2 = Slider(2, range=0..20)
origin_pt = ConstructPoint(XCoordinate=0, YCoordinate=0, ZCoordinate=0)
offset = OffsetCurve(Curve=crv, Distance=root_kerf, Plane=PlaneXY(0, 0, 0), Corners=1)
neg = Negative(Value=tip_washout)
box = DomainBox(Base=PlaneXY(0, 0, 0), X=X_2, Y=Y_2, Z=max_height_2)

# ---- group: set bed width
bed_width = Slider(670, range=0..800)
bed_lenght = Slider(320, range=0..320)
bed_height = Slider(80, range=0..100)
pt = PointXYZ(XComponent=0, YComponent=0, ZComponent=0)
pt_2 = PointXYZ(XComponent=bed_width, YComponent=0, ZComponent=0)
X_3 = UnitX(Factor=1)
pl = PlaneNormal(Origin=pt_2, ZAxis=X_3)
pl_2 = PlaneNormal(Origin=pt, ZAxis=X_3)

# ----
primo_punto = CurveClosestPoint(Point=origin_pt, Curve=offset)  # -> Point, Parameter, Distance

# ---- group: just a bed preview to make sure that paths are possible to made with your cutter
_0 = Slider(0, range=0..100)
dom = Domain(DomainStart=_0, DomainEnd=bed_width)
dom_2 = Domain(DomainStart=_0, DomainEnd=bed_lenght)
dom_3 = Domain(DomainStart=_0, DomainEnd=bed_height)
box_2 = DomainBox(Base=PlaneXY(0, 0, 0), X=dom, Y=dom_2, Z=dom_3)
bed_preview = CustomPreview(Geometry=box_2, Shader=ColourSwatch(SwatchColor=RGBA(255, 255, 255, 31)))

# ----
box_3 = DomainBox(Base=PlaneXY(0, 0, 0), X=X, Y=Y, Z=max_height)
rad = Radians(Degrees=neg)
rad_2 = Radians(Degrees=tip_washout_2)
seam = Seam(Curve=offset, Seam=primo_punto.Parameter)
pdecon = Deconstruct(Point=primo_punto.Point)  # -> XComponent, YComponent, ZComponent
starting_pt = ConstructPoint(XCoordinate=0, YCoordinate=0, ZCoordinate=pdecon.ZComponent)
divide = DivideCurve(Curve=seam, Count=resolution_3, Kinks=True)  # -> Points, Tangents, Parameters
ins = InsertItems(List=divide.Points, Item=starting_pt, Indices=0, Wrap=True)

# ---- group: INPUT CRV
crv_left = Curve(<curve referenced from the Rhino model>)
crv_right = Curve(<curve referenced from the Rhino model>)

# ----
lng = ListLength(List=ins)
ins_2 = InsertItems(List=ins, Item=primo_punto.Point, Indices=lng, Wrap=True)
format_coordinates = Panel("Format(\"G1 X{0:0.000} Y{1:0.000} U{0:0.000} Z{1:0.000} F{2:0}\", x, y, feedrate)")
lng_2 = ListLength(List=ins_2)
ins_3 = InsertItems(List=ins_2, Item=starting_pt, Indices=lng_2, Wrap=True)

tag = TextTag3D(Location=pl, Text="0,0 point for AB axis", Size=Slider(1.541, range=0..3))
tag_2 = TextTag3D(Location=pl_2, Text="0,0 point for XY axis", Size=Slider(1.541, range=0..3))

pdecon_2 = Deconstruct(Point=ins_3)  # -> XComponent, YComponent, ZComponent

# ---- group: Centratura sul piano di lavoro
subtraction = Subtraction(A=X_2, B=wing_span_2)
division = Division(A=subtraction, B=2)
addition = Addition(A=wing_span_2, B=division)

# ----
file_name_root_airfoil = Panel("C:\Users\Stefano Barbareschi\Desktop\planes\foam_cutter\wing_profiles\pw1211.dat")
root_kerf_2 = Slider(1, range=0..10)
root_chord = Slider(235, range=50..1000)
file = ReadFile(File=graft(file_name_root_airfoil), PerLineParse=True)  # -> simplify(Content)
remove_header = CullIndex(List=file, Indices=0, Wrap=False)  # -> simplify(List)
split = TextSplit(Text=remove_header, Separators="    ")
len = TextLength(Text=split)
larger = LargerThan(FirstNumber=len, SecondNumber=0)  # -> LargerThan, OrEqualTo
dispatch = Dispatch(List=split, DispatchPattern=larger.LargerThan)  # -> ListA, ListB
multiplication = Multiplication(A=dispatch.ListA, B=root_chord)
x_coord = ListItem(List=multiplication, Index=0, Wrap=True)
y_coord = ListItem(List=multiplication, Index=1, Wrap=True)
addition_2 = Addition(A=x_coord, B=leading_edge_distance_2)
addition_3 = Addition(A=y_coord, B=bottom_distance_2)
pt_3 = ConstructPoint(XCoordinate=division, YCoordinate=addition_2, ZCoordinate=addition_3)
flatten = FlattenTree(Tree=pt_3, Path="{0}")
intcrv = Interpolate(Vertices=flatten, Degree=3, Periodic=False, KnotStyle=0)  # -> Curve, Length, Domain
offset_2 = OffsetCurve(Curve=intcrv.Curve, Distance=root_kerf_2, Plane=PlaneXY(0, 0, 0), Corners=1)
divide_2 = DivideCurve(Curve=offset_2, Count=resolution_2, Kinks=False)  # -> Points, Tangents, Parameters

eval = Evaluate(F=format_coordinates, x=pdecon_2.YComponent, y=pdecon_2.ZComponent, feedrate=cut_feedrate_3)

# ---- group: Centratura sul piano di lavoro
subtraction_2 = Subtraction(A=X, B=wing_span)
division_2 = Division(A=subtraction_2, B=2)
addition_4 = Addition(A=wing_span, B=division_2)

# ----
file_name_root_airfoil_2 = Panel("C:\Users\Stefano Barbareschi\Desktop\planes\foam_cutter\wing_profiles\AG24.dat")
root_kerf_3 = Slider(1, range=0..10)
root_chord_2 = Slider(230, range=50..1000)
file_2 = ReadFile(File=graft(file_name_root_airfoil_2), PerLineParse=True)  # -> simplify(Content)
remove_header_2 = CullIndex(List=file_2, Indices=0, Wrap=False)  # -> simplify(List)
split_2 = TextSplit(Text=remove_header_2, Separators="    ")
len_2 = TextLength(Text=split_2)
larger_2 = LargerThan(FirstNumber=len_2, SecondNumber=0)  # -> LargerThan, OrEqualTo
dispatch_2 = Dispatch(List=split_2, DispatchPattern=larger_2.LargerThan)  # -> ListA, ListB
multiplication_2 = Multiplication(A=dispatch_2.ListA, B=root_chord_2)
x_coord_2 = ListItem(List=multiplication_2, Index=0, Wrap=True)
y_coord_2 = ListItem(List=multiplication_2, Index=1, Wrap=True)
addition_5 = Addition(A=x_coord_2, B=leading_edge_distance)
addition_6 = Addition(A=y_coord_2, B=bottom_distance)
pt_4 = ConstructPoint(XCoordinate=division_2, YCoordinate=addition_5, ZCoordinate=addition_6)
flatten_2 = FlattenTree(Tree=pt_4, Path="{0}")
intcrv_2 = Interpolate(Vertices=flatten_2, Degree=3, Periodic=False, KnotStyle=0)  # -> Curve, Length, Domain
offset_3 = OffsetCurve(Curve=intcrv_2.Curve, Distance=root_kerf_3, Plane=PlaneXY(0, 0, 0), Corners=1)
divide_3 = DivideCurve(Curve=offset_3, Count=resolution, Kinks=False)  # -> Points, Tangents, Parameters

neg_2 = Negative(Value=root_kerf_3)
gcode_prefix = Panel("""G90
M3""")
join = TextJoin(Text=eval)
concat = Concatenate(FragmentA=gcode_prefix, FragmentB=join)

# ---- group: Calcolo diedro
rad_3 = Radians(Degrees=wing_dihedral_2)
sin = Sine(Value=rad_3)
multiplication_3 = Multiplication(A=wing_span_2, B=sin)

# ----
file_name_tip_airfoil = Panel("C:\Users\Stefano Barbareschi\Desktop\planes\foam_cutter\wing_profiles\pw1211.dat")
tip_chord = Slider(140, range=50..1000)
tip_kerf = Slider(1.5, range=0..10)
file_3 = ReadFile(File=graft(file_name_tip_airfoil), PerLineParse=True)  # -> simplify(Content)
remove_header_3 = CullIndex(List=file_3, Indices=0, Wrap=False)  # -> simplify(List)
split_3 = TextSplit(Text=remove_header_3, Separators="    ")
len_3 = TextLength(Text=split_3)
larger_3 = LargerThan(FirstNumber=len_3, SecondNumber=0)  # -> LargerThan, OrEqualTo
dispatch_3 = Dispatch(List=split_3, DispatchPattern=larger_3.LargerThan)  # -> ListA, ListB
multiplication_4 = Multiplication(A=dispatch_3.ListA, B=tip_chord)
x_coord_3 = ListItem(List=multiplication_4, Index=0, Wrap=True)
y_coord_3 = ListItem(List=multiplication_4, Index=1, Wrap=True)
addition_7 = Addition(A=x_coord_3, B=sweep_mm_2)
addition_8 = Addition(A=y_coord_3, B=bottom_distance_2)
addition_9 = Addition(A=addition_7, B=leading_edge_distance_2)
addition_10 = Addition(A=addition_8, B=multiplication_3)
pt_5 = ConstructPoint(XCoordinate=addition, YCoordinate=addition_9, ZCoordinate=addition_10)
flatten_3 = FlattenTree(Tree=pt_5, Path="{0}")
intcrv_3 = Interpolate(Vertices=flatten_3, Degree=3, Periodic=False, KnotStyle=0)  # -> Curve, Length, Domain
offset_4 = OffsetCurve(Curve=intcrv_3.Curve, Distance=tip_kerf, Plane=PlaneXY(0, 0, 0), Corners=1)
divide_4 = DivideCurve(Curve=offset_4, Count=resolution_2, Kinks=False)  # -> Points, Tangents, Parameters

panel = Panel(concat)
resolution_4 = Slider(50, range=50..5000)

# ---- group: Calcolo diedro
rad_4 = Radians(Degrees=wing_dihedral)
sin_2 = Sine(Value=rad_4)
multiplication_5 = Multiplication(A=wing_span, B=sin_2)

# ----
file_name_tip_airfoil_2 = Panel("C:\Users\Stefano Barbareschi\Desktop\planes\foam_cutter\wing_profiles\AG24.dat")
tip_chord_2 = Slider(140, range=50..1000)
tip_kerf_2 = Slider(1.5, range=0..10)
file_4 = ReadFile(File=graft(file_name_tip_airfoil_2), PerLineParse=True)  # -> simplify(Content)
remove_header_4 = CullIndex(List=file_4, Indices=0, Wrap=False)  # -> simplify(List)
split_4 = TextSplit(Text=remove_header_4, Separators="    ")
len_4 = TextLength(Text=split_4)
larger_4 = LargerThan(FirstNumber=len_4, SecondNumber=0)  # -> LargerThan, OrEqualTo
dispatch_4 = Dispatch(List=split_4, DispatchPattern=larger_4.LargerThan)  # -> ListA, ListB
multiplication_6 = Multiplication(A=dispatch_4.ListA, B=tip_chord_2)
x_coord_4 = ListItem(List=multiplication_6, Index=0, Wrap=True)
y_coord_4 = ListItem(List=multiplication_6, Index=1, Wrap=True)
addition_11 = Addition(A=x_coord_4, B=sweep_mm)
addition_12 = Addition(A=y_coord_4, B=bottom_distance)
addition_13 = Addition(A=addition_11, B=leading_edge_distance)
addition_14 = Addition(A=addition_12, B=multiplication_5)
pt_6 = ConstructPoint(XCoordinate=addition_4, YCoordinate=addition_13, ZCoordinate=addition_14)
flatten_4 = FlattenTree(Tree=pt_6, Path="{0}")
intcrv_4 = Interpolate(Vertices=flatten_4, Degree=3, Periodic=False, KnotStyle=0)  # -> Curve, Length, Domain
offset_5 = OffsetCurve(Curve=intcrv_4.Curve, Distance=tip_kerf_2, Plane=PlaneXY(0, 0, 0), Corners=1)
divide_5 = DivideCurve(Curve=offset_5, Count=resolution, Kinks=False)  # -> Points, Tangents, Parameters

# ---- group: washout
integer_division = IntegerDivision(A=resolution_2, B=2)
item = ListItem(List=divide_2.Points, Index=integer_division, Wrap=True)
item_2 = ListItem(List=divide_4.Points, Index=integer_division, Wrap=True)
ln = Line(StartPoint=item_2, EndPoint=item)
rotax = RotateAxis(Geometry=divide_4.Points, Angle=rad, Axis=ln)  # -> Geometry, Transform

# ---- group: root centroid
end = EndPoints(Curve=intcrv_2.Curve)  # -> Start, End
cls = Closed(Curve=intcrv_2.Curve)  # -> Closed, Periodic
ln_2 = Line(StartPoint=end.Start, EndPoint=end.End)
join_2 = JoinCurves(Curves=[ln_2, intcrv_2.Curve], Preserve=False)
filter = StreamFilter(Gate=cls.Closed, Stream0=join_2, Stream1=intcrv_2.Curve)
area = Area(Geometry=filter)  # -> Area, Centroid

# ---- group: tip centroid
end_2 = EndPoints(Curve=intcrv_4.Curve)  # -> Start, End
cls_2 = Closed(Curve=intcrv_4.Curve)  # -> Closed, Periodic
ln_3 = Line(StartPoint=end_2.Start, EndPoint=end_2.End)
join_3 = JoinCurves(Curves=[intcrv_4.Curve, ln_3], Preserve=False)
filter_2 = StreamFilter(Gate=cls_2.Closed, Stream0=join_3, Stream1=intcrv_4.Curve)
area_2 = Area(Geometry=filter_2)  # -> Area, Centroid

# ---- group: trailing edge
lng_3 = ListLength(List=rotax.Geometry)
lng_4 = ListLength(List=divide_2.Points)
subtraction_3 = Subtraction(A=lng_4, B=1)
subtraction_4 = Subtraction(A=lng_3, B=1)
item_3 = ListItem(List=rotax.Geometry, Index=0, Wrap=True)
item_4 = ListItem(List=divide_2.Points, Index=0, Wrap=True)
item_5 = ListItem(List=rotax.Geometry, Index=subtraction_4, Wrap=True)
item_6 = ListItem(List=divide_2.Points, Index=subtraction_3, Wrap=True)
pdecon_3 = Deconstruct(Point=item_5)  # -> XComponent, YComponent, ZComponent
pdecon_4 = Deconstruct(Point=item_3)  # -> XComponent, YComponent, ZComponent
pdecon_5 = Deconstruct(Point=item_6)  # -> XComponent, YComponent, ZComponent
pdecon_6 = Deconstruct(Point=item_4)  # -> XComponent, YComponent, ZComponent
addition_15 = Addition(A=pdecon_6.YComponent, B=trailing_edge_distance_2)
pt_7 = ConstructPoint(XCoordinate=pdecon_3.XComponent, YCoordinate=addition_15, ZCoordinate=pdecon_3.ZComponent)
pt_8 = ConstructPoint(XCoordinate=pdecon_4.XComponent, YCoordinate=addition_15, ZCoordinate=pdecon_4.ZComponent)
pt_9 = ConstructPoint(XCoordinate=pdecon_5.XComponent, YCoordinate=addition_15, ZCoordinate=pdecon_5.ZComponent)
pt_10 = ConstructPoint(XCoordinate=pdecon_6.XComponent, YCoordinate=addition_15, ZCoordinate=pdecon_6.ZComponent)

# ----
# Gcode prefix: ( Plan XY )
# G17
# ( SET LENGTH UNITS )
# G21
# ( SET FEED RATE MODE )
# G94
# ( Move max speed )
# F600
# F60
rescale_coordinates = ValueList({"1", "10", "100", "1000"}, selected="10")
cut_feedrate_4 = Slider(100, range=50..300)
prefix_b_axis = Panel(" Z")
format_coordinates_2 = Panel("Format(\"{0:0.000}\", x)")
prefix_x_axis = Panel(" X")
prefix_a_axis = Panel(" U")
linear_interpolation_axis = Panel("G01")
prefix_y_axis = Panel(" Y")
gcode_prefix_2 = Panel(" F")

# ---- group: wing lines
ins_4 = InsertItems(List=divide_2.Points, Item=pt_10, Indices=0, Wrap=True)
ins_5 = InsertItems(List=rotax.Geometry, Item=pt_8, Indices=0, Wrap=True)
lng_5 = ListLength(List=ins_4)
lng_6 = ListLength(List=ins_5)
ins_6 = InsertItems(List=ins_4, Item=pt_9, Indices=lng_5, Wrap=True)
ins_7 = InsertItems(List=ins_5, Item=pt_7, Indices=lng_6, Wrap=True)
ln_4 = Line(StartPoint=ins_6, EndPoint=ins_7)

# ---- group: washout
ln_5 = Line(StartPoint=area.Centroid, EndPoint=area_2.Centroid)
rotax_2 = RotateAxis(Geometry=divide_5.Points, Angle=rad_2, Axis=ln_5)  # -> Geometry, Transform

# ----
pt_11 = ConstructPoint(XCoordinate=0, YCoordinate=0, ZCoordinate=mid_plane_2)
pt_12 = ConstructPoint(XCoordinate=0, YCoordinate=0, ZCoordinate=mid_plane)
xy = XYPlane(Origin=pt_11)
xy_2 = XYPlane(Origin=pt_12)
concat_2 = Concatenate(FragmentA=gcode_prefix_2, FragmentB=cut_feedrate_4)

# ---- group: Machine axis projection
ext = ExtendCurve(Curve=ln_4, Type=0, Start=division, End=division)
end_3 = EndPoints(Curve=ext)  # -> Start, End

# ----
lng_7 = ListLength(List=ext)
filter_3 = StreamFilter(Gate=both_wings_2, Stream1=ext)
mirror = Mirror(Geometry=filter_3, Plane=xy)  # -> Geometry, Transform
end_4 = EndPoints(Curve=mirror.Geometry)  # -> Start, End
crv_cp = CurveClosestPoint(Point=area_2.Centroid, Curve=offset_5)  # -> Point, Parameter, Distance
crv_cp_2 = CurveClosestPoint(Point=area.Centroid, Curve=offset_3)  # -> Point, Parameter, Distance
vec2pt = Vector2Pt(PointA=crv_cp.Point, PointB=area_2.Centroid, Unitize=False)  # -> Vector, Length
vec2pt_2 = Vector2Pt(PointA=crv_cp_2.Point, PointB=area.Centroid, Unitize=False)  # -> Vector, Length
amp = Amplitude(Vector=vec2pt.Vector, Amplitude=spar_width)
pdecon_7 = Deconstruct(Point=end_4.Start)  # -> XComponent, YComponent, ZComponent
pdecon_8 = Deconstruct(Point=end_4.End)  # -> XComponent, YComponent, ZComponent
amp_2 = Amplitude(Vector=vec2pt_2.Vector, Amplitude=spar_width)
rad_5 = Radians(Degrees=90)
X_4 = UnitX(Factor=1)

# ---- group: trailing edge
lng_8 = ListLength(List=rotax_2.Geometry)
lng_9 = ListLength(List=divide_3.Points)
subtraction_5 = Subtraction(A=lng_9, B=1)
subtraction_6 = Subtraction(A=lng_8, B=1)
item_7 = ListItem(List=rotax_2.Geometry, Index=0, Wrap=True)
item_8 = ListItem(List=divide_3.Points, Index=0, Wrap=True)
item_9 = ListItem(List=rotax_2.Geometry, Index=subtraction_6, Wrap=True)
item_10 = ListItem(List=divide_3.Points, Index=subtraction_5, Wrap=True)
pdecon_9 = Deconstruct(Point=item_9)  # -> XComponent, YComponent, ZComponent
pdecon_10 = Deconstruct(Point=item_7)  # -> XComponent, YComponent, ZComponent
pdecon_11 = Deconstruct(Point=item_10)  # -> XComponent, YComponent, ZComponent
pdecon_12 = Deconstruct(Point=item_8)  # -> XComponent, YComponent, ZComponent
addition_16 = Addition(A=pdecon_12.YComponent, B=trailing_edge_distance)
pt_13 = ConstructPoint(XCoordinate=pdecon_9.XComponent, YCoordinate=addition_16, ZCoordinate=pdecon_9.ZComponent)
pt_14 = ConstructPoint(XCoordinate=pdecon_10.XComponent, YCoordinate=addition_16, ZCoordinate=pdecon_10.ZComponent)
pt_15 = ConstructPoint(XCoordinate=pdecon_11.XComponent, YCoordinate=addition_16, ZCoordinate=pdecon_11.ZComponent)
pt_16 = ConstructPoint(XCoordinate=pdecon_12.XComponent, YCoordinate=addition_16, ZCoordinate=pdecon_12.ZComponent)

# ----
rad_6 = Radians(Degrees=90)
X_5 = UnitX(Factor=1)
expression = Expression(
    isDouble=both_wings_2,
    x=pdecon_7.YComponent,
    y=pdecon_7.ZComponent,
    u=pdecon_8.YComponent,
    z=pdecon_8.ZComponent,
    feedrate=cut_feedrate_2,
    Expression="If(isDouble = true, Format(\"G1 X{0:0.000} Y{1:0.000} U{2:0.000} Z{3:0.000} F{4:0}\", x, y, u, z, feedrate), \"\")")
vrot = Rotate(Vector=amp_2, Axis=X_4, Angle=rad_5)
vrot_2 = Rotate(Vector=amp, Axis=X_5, Angle=rad_6)

# ---- group: wing lines
ins_8 = InsertItems(List=rotax_2.Geometry, Item=pt_14, Indices=0, Wrap=True)
ins_9 = InsertItems(List=divide_3.Points, Item=pt_16, Indices=0, Wrap=True)
lng_10 = ListLength(List=ins_9)
lng_11 = ListLength(List=ins_8)
ins_10 = InsertItems(List=ins_9, Item=pt_15, Indices=lng_10, Wrap=True)
ins_11 = InsertItems(List=ins_8, Item=pt_13, Indices=lng_11, Wrap=True)
ln_6 = Line(StartPoint=ins_10, EndPoint=ins_11)

# ----
pt_17 = ConstructPoint(XCoordinate=0, YCoordinate=0, ZCoordinate=0)
pt_18 = ConstructPoint(XCoordinate=0, YCoordinate=0, ZCoordinate=travel_height_2)
pt_19 = ConstructPoint(XCoordinate=0, YCoordinate=addition_15, ZCoordinate=travel_height_2)
ins_12 = InsertItems(List=pt_17, Item=pt_18, Indices=1, Wrap=True)
ins_13 = InsertItems(List=ins_12, Item=pt_19, Indices=2, Wrap=True)
format_coordinates_3 = Panel("Format(\"G1 X{0:0.000} Y{1:0.000} U{0:0.000} Z{1:0.000} F{2:0}\", x, y, feedrate)")
pdecon_13 = Deconstruct(Point=ins_13)  # -> XComponent, YComponent, ZComponent
eval_2 = Evaluate(F=format_coordinates_3, X=pdecon_13.YComponent, y=pdecon_13.ZComponent, feedrate=move_feedrate_2)
join_4 = TextJoin(Text=eval_2)
panel_2 = Panel(join_4)

rev = ReverseList(List=ins_13)
format_coordinates_4 = Panel("Format(\"G1 X{0:0.000} Y{1:0.000} U{0:0.000} Z{1:0.000} F{2:0}\", x, y, feedrate)")
pdecon_14 = Deconstruct(Point=rev)  # -> XComponent, YComponent, ZComponent
eval_3 = Evaluate(F=format_coordinates_4, X=pdecon_14.YComponent, y=pdecon_14.ZComponent, feedrate=move_feedrate_2)
join_5 = TextJoin(Text=eval_3)
panel_3 = Panel(join_5)

move = Move(Geometry=crv_cp_2.Point, Motion=amp_2)  # -> Geometry, Transform
move_2 = Move(Geometry=crv_cp_2.Point, Motion=vrot)  # -> Geometry, Transform
move_3 = Move(Geometry=move_2.Geometry, Motion=amp_2)  # -> Geometry, Transform
move_4 = Move(Geometry=crv_cp.Point, Motion=vrot_2)  # -> Geometry, Transform
move_5 = Move(Geometry=move_4.Geometry, Motion=amp)  # -> Geometry, Transform
move_6 = Move(Geometry=crv_cp.Point, Motion=amp)  # -> Geometry, Transform
ln_7 = Line(
    StartPoint=[crv_cp_2.Point, move_2.Geometry, move_3.Geometry, move.Geometry],
    EndPoint=[crv_cp.Point, move_4.Geometry, move_5.Geometry, move_6.Geometry])

# ---- group: Machine axis projection
ext_2 = ExtendCurve(Curve=ln_6, Type=0, Start=division_2, End=division_2)
end_5 = EndPoints(Curve=ext_2)  # -> Start, End

# ----
lng_12 = ListLength(List=ext_2)
filter_4 = StreamFilter(Gate=both_wings, Stream1=ext_2)
mirror_2 = Mirror(Geometry=filter_4, Plane=xy_2)  # -> Geometry, Transform
end_6 = EndPoints(Curve=mirror_2.Geometry)  # -> Start, End
pdecon_15 = Deconstruct(Point=end_6.Start)  # -> XComponent, YComponent, ZComponent
pdecon_16 = Deconstruct(Point=end_6.End)  # -> XComponent, YComponent, ZComponent
expression_2 = Expression(
    isDouble=both_wings,
    x=pdecon_15.YComponent,
    y=pdecon_15.ZComponent,
    u=pdecon_16.YComponent,
    z=pdecon_16.ZComponent,
    feedrate=cut_feedrate,
    Expression="If(isDouble = true, Format(\"G1 X{0:0.000} Y{1:0.000} U{2:0.000} Z{3:0.000} F{4:0}\", x, y, u, z, feedrate), \"\")")
join_6 = TextJoin(Text=expression)

format_coordinates_5 = Panel("Format(\"G1 X{0:0.000} Y{1:0.000} U{2:0.000} Z{3:0.000} F{4:0}\", x, y, u, z, feedrate)")
pdecon_17 = Deconstruct(Point=end_3.End)  # -> XComponent, YComponent, ZComponent
pdecon_18 = Deconstruct(Point=end_3.Start)  # -> XComponent, YComponent, ZComponent
eval_4 = Evaluate(
    F=format_coordinates_5,
    X=pdecon_18.YComponent,
    y=pdecon_18.ZComponent,
    u=pdecon_17.YComponent,
    z=pdecon_17.ZComponent,
    feedrate=cut_feedrate_2)
gcode_end = Panel("M5")
gcode_prefix_3 = Panel("""G90
M3""")
join_7 = TextJoin(Text=eval_4)
concat_3 = Concatenate(
    GcodePrefix=gcode_prefix_3,
    StartPosition=join_4,
    FragmentB=join_7,
    SecondCutOpt=join_6,
    FragmentH=join_5,
    FragmentI=gcode_end)
panel_4 = Panel(concat_3)

pt_20 = ConstructPoint(XCoordinate=0, YCoordinate=0, ZCoordinate=0)
pt_21 = ConstructPoint(XCoordinate=0, YCoordinate=0, ZCoordinate=travel_height)
pt_22 = ConstructPoint(XCoordinate=0, YCoordinate=addition_16, ZCoordinate=travel_height)
ins_14 = InsertItems(List=pt_20, Item=pt_21, Indices=1, Wrap=True)
ins_15 = InsertItems(List=ins_14, Item=pt_22, Indices=2, Wrap=True)
format_coordinates_6 = Panel("Format(\"G1 X{0:0.000} Y{1:0.000} U{0:0.000} Z{1:0.000} F{2:0}\", x, y, feedrate)")
pdecon_19 = Deconstruct(Point=ins_15)  # -> XComponent, YComponent, ZComponent
eval_5 = Evaluate(F=format_coordinates_6, X=pdecon_19.YComponent, y=pdecon_19.ZComponent, feedrate=move_feedrate)
join_8 = TextJoin(Text=eval_5)
panel_5 = Panel(join_8)

rev_2 = ReverseList(List=ins_15)
format_coordinates_7 = Panel("Format(\"G1 X{0:0.000} Y{1:0.000} U{0:0.000} Z{1:0.000} F{2:0}\", x, y, feedrate)")
pdecon_20 = Deconstruct(Point=rev_2)  # -> XComponent, YComponent, ZComponent
eval_6 = Evaluate(F=format_coordinates_7, X=pdecon_20.YComponent, y=pdecon_20.ZComponent, feedrate=move_feedrate)
join_9 = TextJoin(Text=eval_6)
panel_6 = Panel(join_9)

join_10 = TextJoin(Text=expression_2)

format_coordinates_8 = Panel("Format(\"G1 X{0:0.000} Y{1:0.000} U{2:0.000} Z{3:0.000} F{4:0}\", x, y, u, z, feedrate)")
pdecon_21 = Deconstruct(Point=end_5.End)  # -> XComponent, YComponent, ZComponent
pdecon_22 = Deconstruct(Point=end_5.Start)  # -> XComponent, YComponent, ZComponent
eval_7 = Evaluate(
    F=format_coordinates_8,
    X=pdecon_22.YComponent,
    y=pdecon_22.ZComponent,
    u=pdecon_21.YComponent,
    z=pdecon_21.ZComponent,
    feedrate=cut_feedrate)
gcode_end_2 = Panel("M5")
gcode_prefix_4 = Panel("""G90
M3""")
join_11 = TextJoin(Text=eval_7)
concat_4 = Concatenate(
    GcodePrefix=gcode_prefix_4,
    StartPosition=join_8,
    FragmentB=join_11,
    SecondCutOpt=join_10,
    FragmentH=join_9,
    FragmentI=gcode_end_2)
panel_7 = Panel(concat_4)

# ---- group: align geometry to middle point of bed
area_3 = Area(Geometry=crv_left)  # -> Area, Centroid
area_4 = Area(Geometry=crv_right)  # -> Area, Centroid
ln_8 = Line(PointA=pt, PointB=pt_2)
ln_9 = Line(PointA=area_3.Centroid, PointB=area_4.Centroid)

# ----
midpt = CurveMiddle(Curve=ln_8)
midpt_2 = CurveMiddle(Curve=ln_9)

# ---- group: align geometry to middle point of bed (continued)
pcomp = Decompose(Point=midpt_2)  # -> XComponent, YComponent, ZComponent
pt_23 = PointXYZ(XComponent=pcomp.XComponent, YComponent=0, ZComponent=0)
vec2pt_3 = Vector2Pt(PointA=pt_23, PointB=midpt, Unitize=False)  # -> Vector, Length
move_7 = Move(Geometry=crv_right, Translation=vec2pt_3.Vector)  # -> Geometry, Transform
move_8 = Move(Geometry=crv_left, Translation=vec2pt_3.Vector)  # -> Geometry, Transform

# ----
divide_6 = DivideCurve(Curve=move_7.Geometry, Count=resolution_4, Kinks=False)  # -> Points, Tangents, Parameters
divide_7 = DivideCurve(Curve=move_8.Geometry, Count=resolution_4, Kinks=False)  # -> Points, Tangents, Parameters

# ---- group: pathfinder ;)
resolution_5 = Slider(1, range=0..1)
divlength = DivideLength(Length=resolution_5)  # -> Points, Tangents, Parameters
crv_cp_3 = CurveCP(Point=divide_7.Points, Curve=move_7.Geometry)  # -> Point, Parameter, Distance; disabled
ln_10 = Line(PointA=divide_7.Points, PointB=divide_6.Points)
plx = LinePlane(Line=ln_10, Plane=pl_2)  # -> Point, ParamL, ParamP
plx_2 = LinePlane(Line=ln_10, Plane=pl)  # -> Point, ParamL, ParamP

# ---- group: GCODE writer
pcomp_2 = Decompose(Point=plx_2.Point)  # -> XComponent, YComponent, ZComponent
pcomp_3 = Decompose(Point=plx.Point)  # -> XComponent, YComponent, ZComponent
ab = PointXYZ(XComponent=pcomp_2.YComponent, YComponent=pcomp_2.ZComponent, ZComponent=0)
xy_3 = PointXYZ(XComponent=pcomp_3.YComponent, YComponent=pcomp_3.ZComponent, ZComponent=0)
ab_axis = Decompose(Point=ab)  # -> XComponent, YComponent, ZComponent
xy_axis = Decompose(Point=xy_3)  # -> XComponent, YComponent, ZComponent

# ----
multiplication_7 = Multiplication(A=xy_axis.YComponent, B=rescale_coordinates)
multiplication_8 = Multiplication(A=ab_axis.YComponent, B=rescale_coordinates)
multiplication_9 = Multiplication(A=xy_axis.XComponent, B=rescale_coordinates)
multiplication_10 = Multiplication(A=ab_axis.XComponent, B=rescale_coordinates)
eval_8 = Evaluate(F=format_coordinates_2, x=multiplication_7)
eval_9 = Evaluate(F=format_coordinates_2, x=multiplication_8)
eval_10 = Evaluate(F=format_coordinates_2, x=multiplication_9)
eval_11 = Evaluate(F=format_coordinates_2, x=multiplication_10)
concat_5 = Concatenate(FragmentA=prefix_x_axis, FragmentB=eval_10)
concat_6 = Concatenate(FragmentA=prefix_y_axis, FragmentB=eval_8)
concat_7 = Concatenate(FragmentA=prefix_b_axis, FragmentB=eval_9)
concat_8 = Concatenate(FragmentA=prefix_a_axis, FragmentB=eval_11)
# READ FIRST: G Code generated with this generator wont probably
# work with any machine. You need to add some more instructions, depending on machine which would be used.
# 
# Also start and end point should be added to instructions
# list.
concat_9 = Concatenate(FragmentA=linear_interpolation_axis, FragmentB=concat_5)
concat_10 = Concatenate(FragmentA=concat_9, FragmentB=concat_6)
concat_11 = Concatenate(FragmentA=concat_10, FragmentB=concat_8)
concat_12 = Concatenate(FragmentA=concat_11, FragmentB=concat_7)
concat_13 = Concatenate(FragmentA=concat_12, FragmentB=concat_2)

# ---- group: GCODE writer (continued)
right_click_stream_contents_to_txt_after = Panel(concat_13)  # "right click -> stream contents to txt, after add *.nc extension(probably)"
